# Grasshopper definition GeometryExport.gh (Grasshopper 1.0.7)
# plug-ins: Kangaroo2 Components

# ---- group: Collider
# Export
crv = Curve([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])

# ---- group: Origin
crv_2 = Curve(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)

# ----
# Import
panel = Panel("./out.pp")
disc = Discontinuity(Curve=crv, Level=1)  # -> Points, Parameters
disc_2 = Discontinuity(Curve=crv_2, Level=1)  # -> Points, Parameters
path = FilePath(panel)
duppt = RemoveDuplicatePts(Points=disc.Points, Tolerance=0.01)
duppt_2 = RemoveDuplicatePts(Points=disc_2.Points, Tolerance=0.01)
c_script = CSharpScript(path=path)  # -> out, A; inputs path: String
# ---------- c_script: C# usings ----------
using System.IO;
using System.Text;
# ---------- c_script: C# ----------
    const Int32 BufferSize = 128;
    Grasshopper.DataTree<Point3d> output = new Grasshopper.DataTree<Point3d>();

    using (var fileStream = File.OpenRead(path)){

      var tree_path = 0;
      using (var streamReader = new StreamReader(fileStream, Encoding.ASCII, true, BufferSize)) {
        String line;

        while ((line = streamReader.ReadLine()) != null)
        {
          if(line == "# Curve"){
            tree_path++;
          } else{
            string[] parts = line.Split(',');
            Print(parts[0]);
            var x = (float) Convert.ToDouble(parts[0]);
            var y = (float) Convert.ToDouble(parts[1]);
            var z = (float) Convert.ToDouble(parts[2]);
            output.Add(new Point3d(x, y, z), new GH_Path(tree_path));
          }

        }
      }
    }
    A = output;
# ---------- end c_script ----------
pdecon = Deconstruct(Point=duppt)  # -> XComponent, YComponent, ZComponent
pdecon_2 = Deconstruct(Point=duppt_2)  # -> XComponent, YComponent, ZComponent
nurbs = NurbsCurve(Vertices=c_script.A, Degree=3, Periodic=True)  # -> Curve, Length, Domain
concat = Concatenate(FragmentA=pdecon.XComponent, FragmentD=",", FragmentB=pdecon.YComponent, FragmentE=",", FragmentC=pdecon.ZComponent)
concat_2 = Concatenate(
    FragmentA=pdecon_2.XComponent,
    FragmentD=",",
    FragmentB=pdecon_2.YComponent,
    FragmentE=",",
    FragmentC=pdecon_2.ZComponent)
ins = InsertItems(List=concat, Item="# Collider", Indices="0", Wrap=True)
ins_2 = InsertItems(List=concat_2, Item="# Origin", Indices="0", Wrap=True)
panel_2 = Panel(ins)
panel_3 = Panel(ins_2)
entwine = Entwine(Branch0X=panel_2, Branch1X=panel_3, FlattenInputs=False)
join = TextJoin(Text=flatten(entwine))
panel_4 = Panel(join)
